# Grasshopper definition STAIR DESIGN FINAL 1.gh (Grasshopper 1.0.8)
# plug-ins: Pufferfish, Anemone

number_slider = Slider(14, range=0..100)
series = Series(Start=0, Step=Slider(11, range=0..100), Count=number_slider)
range = Range(Domain=Domain(0, 1), Steps=expr("x-1", number_slider))
graph = GraphMapper(
    range,
    x0=0,
    x1=1,
    y0=0,
    y1=1,
    container_name="Bezier",
    cpx=[0, 1, 0.7953678966, 1],
    cpy=[0, 0, 0.1528660059, 0.0967348218])
multiplication = Multiplication(A=graph, B=Slider(493, range=0..1000))
pt = ConstructPoint(XCoordinate=series, YCoordinate=0, ZCoordinate=multiplication)
number_slider_2 = Slider(743, range=0..3000)
intcrv = Interpolate(Vertices=pt, Degree=3, Periodic=False, KnotStyle=1)  # -> Curve, Length, Domain
multiplication_2 = Multiplication(A=number_slider_2, B=Slider(1.213, range=0..2))
Y = UnitY(Factor=multiplication_2)
move = Move(Geometry=intcrv.Curve, Motion=Y)  # -> Geometry, Transform
Z = UnitZ(Factor=number_slider_2)
move_2 = Move(Geometry=move.Geometry, Motion=Z)  # -> Geometry, Transform
division = Division(A=number_slider_2, B=Slider(22, range=0..100))
Y_2 = UnitY(Factor=1)
# STEPS CURVE
loft = Loft(
    Curves=[intcrv.Curve, move_2.Geometry],
    Options={Adjust=False, Closed=False, LoftEnds=0, LoftSimp=0, LoftType=0, Rebuild=10, Refit=0.01})
contour = Contour(Shape=loft, Point=Point(0, 0, 0), Direction=Y_2, Distance=division)
mirror = Mirror(Geometry=contour, Plane=PlaneYZ(0, 0, 0))  # -> Geometry, Transform
join = JoinCurves(Curves=[contour, mirror.Geometry], Preserve=False)

pt_2 = Point(Point(-0.3476433598, -0.1875422262, 0))
number_slider_3 = Slider(46, range=0..50)
series_2 = Series(Start=pt_2, Step=Slider(9, range=0..10), Count=number_slider_3)
number_slider_4 = Slider(5.512, range=0..10)
number_slider_5 = Slider(6.053, range=0..10)
Y_3 = UnitY(Factor=1)
Z_2 = UnitZ(Factor=series_2)
neg = Negative(Value=number_slider_4)
neg_2 = Negative(Value=number_slider_5)
move_3 = Move(Geometry=pt_2, Motion=Z_2)  # -> Geometry, Transform
dom = ConstructDomain(DomainStart=neg, DomainEnd=number_slider_4)
dom_2 = ConstructDomain(DomainStart=neg_2, DomainEnd=number_slider_5)
random = Random(Range=dom, Number=number_slider_3, Seed=Slider(24, range=0..100))
Y_4 = UnitY(Factor=Slider(57, range=0..100))
random_2 = Random(Range=dom_2, Number=number_slider_3, Seed=Slider(28, range=0..100))
X = UnitX(Factor=random)
move_4 = Move(Geometry=move_3.Geometry, Motion=Y_4)  # -> Geometry, Transform
X_2 = UnitX(Factor=random_2)
move_5 = Move(Geometry=move_4.Geometry, Motion=X)  # -> Geometry, Transform
# RAILING
move_6 = Move(Geometry=move_3.Geometry, Motion=X_2)  # -> Geometry, Transform
nurbs = NurbsCurve(Vertices=move_5.Geometry, Degree=3, Periodic=False)  # -> Curve, Length, Domain
nurbs_2 = NurbsCurve(Vertices=move_6.Geometry, Degree=3, Periodic=False)  # -> Curve, Length, Domain
loft_2 = Loft(
    Curves=[nurbs_2.Curve, nurbs.Curve],
    Options={Adjust=False, Closed=False, LoftEnds=0, LoftSimp=0, LoftType=0, Rebuild=10, Refit=0.01})
sdivide = DivideSurface(Surface=loft_2, UCount=Slider(7, range=0..10), VCount=Slider(42, range=0..100))  # -> Points, Normals, Parameters
panel = Panel("""{0;0;0;0}
{0;0;0;4}
{0;0;0;5}
{0;0;0;8}""")
split = SplitTree(Data=sdivide.Points, Masks=panel)  # -> Positive, Negative
dispatch = Dispatch(List=split.Positive, DispatchPattern=[True, False])  # -> ListA, ListB
dispatch_2 = Dispatch(List=split.Negative, DispatchPattern=[True, False])  # -> ListA, ListB
pt_3 = Point(dispatch.ListA)
pt_4 = Point(dispatch_2.ListB)
weave = Weave(Pattern=[0, 1], Stream0=pt_3, Stream1=pt_4, NullGaps=False)
intcrv_2 = Interpolate(Vertices=weave, Degree=3, Periodic=False, KnotStyle=1)  # -> Curve, Length, Domain
pipe = Pipe(Curve=intcrv_2.Curve, Radius=Slider(0.5, range=-0.5..0.5), Caps=0)

crv = Curve(<curve referenced from the Rhino model>)
end = EndPoints(Curve=join)  # -> Start, End
# STEPS PROFILE
area = Area(Geometry=crv)  # -> Area, Centroid
Z_3 = UnitZ(Factor=1)
pframe = PerpFrame(Curve=reparameterize(join), Parameter=Slider(0, range=0..1))
mirror_2 = Mirror(Geometry=pframe, Plane=PlaneYZ(0, 0, 0))  # -> Geometry, Transform
orient = OrientDirection(Geometry=crv, PointA=area.Centroid, DirectionA=Z_3, PointB=end.Start, DirectionB=mirror_2.Geometry)  # -> Geometry, Transform
scale = Scale(Geometry=orient.Geometry, Center=end.Start, Factor=Slider(0.9, range=0..10))  # -> Geometry, Transform

swp1 = Sweep1(Rail=join, Sections=scale.Geometry, Miter=1)
crv_2 = Curve(intcrv.Curve)
intcrv_3 = Interpolate(Vertices=sdivide.Points, Degree=3, Periodic=False, KnotStyle=1)  # -> Curve, Length, Domain
mirror_3 = Mirror(Geometry=crv_2, Plane=PlaneYZ(0, 0, 0))  # -> Geometry, Transform
end_2 = EndPoints(Curve=crv_2)  # -> Start, End
end_3 = EndPoints(Curve=mirror_3.Geometry)  # -> Start, End
item = ListItem(List=weave, Index=0, Wrap=True)
dom_3 = ConstructDomain(DomainStart=Slider(1.25, range=0..10), DomainEnd=Slider(4.05, range=0..10))
pt_5 = Point(end_2.End)
random_3 = Random(Range=dom_3, Number=7, Seed=Slider(2, range=0..10))  # -> graft(Random)
rectangle = Rectangle(Plane=item, XSize=Slider(0.44, range=0..1), YSize=random_3, Radius=0)  # -> Rectangle, Length
swp1_2 = Sweep1(Rail=intcrv_2.Curve, Sections=rectangle.Rectangle, Miter=1)
move2pt = MoveToPoint(Geometry=swp1_2, PointA=pt_2, PointB=pt_5)  # -> Moved, Vector, Transform
yz = YZPlane(Origin=pt_5)
rotate = Rotate(Geometry=move2pt.Moved, Angle=degrees(Slider(309, range=0..1000)), Plane=yz)  # -> Geometry, Transform

cluster = Cluster(C=intcrv.Curve, C_2=move_2.Geometry)  # -> S, L
# TWIST CIRCLE
number_slider_6 = Slider(150, range=0..1000)
circle = CircleCNR(Center=cluster.S, Normal=cluster.L, Radius=number_slider_6)
curvepoint = PointOnCurve(circle, parameter=1)
circle_2 = CircleCNR(Center=curvepoint, Normal=cluster.L, Radius=Slider(300, range=0..1000))
line = LineSDL(Start=circle_2, Direction=cluster.L, Length=expr("x*2", Slider(636, range=0..1000)))
curvepoint_2 = PointOnCurve(circle_2, parameter=0.71)
line_2 = LineSDL(Start=curvepoint_2, Direction=line, Length=line)
end_4 = EndPoints(Curve=line_2)  # -> Start, End
twist = Twist(Geometry=line_2, Axis=line, Angle=expr("X*10", degrees(Slider(63, range=0..360))), Infinite=False, Rigid=False)
xy = XYPlane(Origin=end_4.Start)

pt_6 = Point(end_3.End)

scale_2 = Scale(Geometry=rotate.Geometry, Center=pt_5, Factor=Slider(3.07, range=0..10))  # -> Geometry, Transform
move2pt_2 = MoveToPoint(Geometry=scale_2.Geometry, PointA=pt_5, PointB=pt_6)  # -> Moved, Vector, Transform

number_slider_7 = Slider(100, range=0..100)
recgrid = Rectangular(
    Plane=xy,
    SizeX=Slider(2.59, range=0..10),
    SizeY=Slider(13, range=0..100),
    ExtentX=number_slider_7,
    ExtentY=number_slider_7)  # -> Cells, flatten(Points)
# TWISTED ROOF
pt_7 = Point(recgrid.Points)
pdecon = Deconstruct(Point=pt_7)  # -> XComponent, YComponent, ZComponent
multiplication_3 = Multiplication(A=Slider(2, range=0..10), B=Slider(336, range=0..1000))
multiplication_4 = Multiplication(A=Slider(6, range=0..10), B=Slider(180, range=0..1000))
bnd = Bounds(Numbers=pdecon.XComponent)
bnd_2 = Bounds(Numbers=pdecon.YComponent)
dom_4 = ConstructDomain(DomainStart=0, DomainEnd=multiplication_3)
dom_5 = ConstructDomain(DomainStart=0, DomainEnd=multiplication_4)
remap = RemapNumbers(Value=pdecon.XComponent, Source=bnd, Target=dom_4)  # -> Mapped, Clipped
remap_2 = RemapNumbers(Value=pdecon.YComponent, Source=bnd_2, Target=dom_5)  # -> Mapped, Clipped
rad = Radians(Degrees=remap.Mapped)
number_slider_8 = Slider(5, range=0..10)
rad_2 = Radians(Degrees=remap_2.Mapped)
sin = Sine(Value=rad)
sin_2 = Sine(Value=rad_2)
multiplication_5 = Multiplication(A=sin, B=number_slider_8)
multiplication_6 = Multiplication(A=number_slider_8, B=sin_2)
multiplication_7 = Multiplication(A=multiplication_5, B=multiplication_6)
Z_4 = UnitZ(Factor=multiplication_7)
move_7 = Move(Geometry=pt_7, Motion=Z_4)  # -> Geometry, Transform
pdecon_2 = Deconstruct(Point=move_7.Geometry)  # -> XComponent, YComponent, ZComponent
loop_start = LoopStart(Data=pdecon_2.ZComponent, Count=Slider(32, range=0..50), Trigger=Button())  # -> port, Data, Counter
graph_2 = GraphMapper(
    pdecon_2.XComponent,
    x0=0,
    x1=1,
    y0=0,
    y1=1,
    amplitude=0.3997811675,
    container_name="Perlin",
    decay=0.3,
    frequency=0.06604969501,
    x_offset=0.5,
    y_offset=0.5)
bnd_3 = Bounds(Numbers=graph_2)
remap_3 = RemapNumbers(Value=graph_2, Source=bnd_3, Target=Domain(0, 1))  # -> Mapped, Clipped
addition = Addition(A=loop_start.Data, B=remap_3.Mapped)
loop_end = LoopEnd(port=loop_start.port, Data=addition, state="Constant output")
pt_8 = ConstructPoint(XCoordinate=pdecon_2.XComponent, YCoordinate=pdecon_2.YComponent, ZCoordinate=loop_end)
int = Integer(number_slider_7)
srfgrid = SurfaceFromPoints(Points=pt_8, UCount=expr("x+1", int), Interpolate=False)

pt_9 = Point(end_4.Start)
xz = XZPlane(Origin=pt_9)
rotate_2 = Rotate(Geometry=srfgrid, Angle=Slider(2.15, range=0..10), Plane=xz)  # -> Geometry, Transform
yz_2 = YZPlane(Origin=pt_9)
orient_2 = OrientDirection(Geometry=srfgrid, PointA=Point(0, 0, 0), DirectionA=Vector(0, 0, 1), PointB=Point(0, 0, 0), DirectionB=Vector(0, 0, 1))  # -> Geometry, Transform
rotate_3 = Rotate(Geometry=rotate_2.Geometry, Angle=degrees(Slider(403, range=0..1000)), Plane=yz_2)  # -> Geometry, Transform
crv_3 = Curve(line_2)
rotax = RotateAxis(Geometry=rotate_3.Geometry, Angle=degrees(Slider(37, range=0..1000)), Axis=crv_3)  # -> Geometry, Transform
twist_2 = Twist(Geometry=rotax.Geometry, Axis=line, Angle=expr("x*10", Slider(2.2, range=0..5)), Infinite=Toggle(True), Rigid=False)  # disabled

# ==== cluster Cluster
C = ClusterInput()
C_2 = ClusterInput()
end = EndPoints(Curve=C)  # -> Start, End
end_2 = EndPoints(Curve=C_2)  # -> Start, End
S = ClusterOutput(end.Start)
ln = Line(StartPoint=end.Start, EndPoint=end_2.Start)
L = ClusterOutput(ln)
