# Grasshopper definition STAIR DESIGN FINAL OPTIONAL.gh (Grasshopper 1.0.8)
# plug-ins: Pufferfish

number_slider = Slider(17, range=0..100)
series = Series(Start=0, Step=Slider(12, range=0..100), Count=number_slider)
range = Range(Domain=Domain(0, 1), Steps=expr("x-1", number_slider))
graph = GraphMapper(
    range,
    x0=0,
    x1=1,
    y0=0,
    y1=1,
    container_name="Bezier",
    cpx=[0, 1, 0.7998300791, 1],
    cpy=[0, 0, 0.3517498374, 0.2049553394])
multiplication = Multiplication(A=graph, B=Slider(250, range=0..1000))
pt = ConstructPoint(XCoordinate=series, YCoordinate=0, ZCoordinate=multiplication)
intcrv = Interpolate(Vertices=pt, Degree=3, Periodic=False, KnotStyle=1)  # -> Curve, Length, Domain
mirror = Mirror(Geometry=intcrv.Curve, Plane=PlaneYZ(0, 0, 0))  # -> Geometry, Transform
join = JoinCurves(Curves=[intcrv.Curve, mirror.Geometry], Preserve=False)

number_slider_2 = Slider(18, range=0..20)

number_slider_3 = Slider(17, range=0..100)
series_2 = Series(Start=0, Step=Slider(12, range=0..100), Count=number_slider_3)
range_2 = Range(Domain=Domain(0, 1), Steps=expr("x-1", number_slider_3))
graph_2 = GraphMapper(
    range_2,
    x0=0,
    x1=1,
    y0=0,
    y1=1,
    container_name="Bezier",
    cpx=[0, 1, 0.7998300791, 1],
    cpy=[0, 0, 0.3517498374, 0.2049553394])
multiplication_2 = Multiplication(A=graph_2, B=Slider(250, range=0..1000))
pt_2 = ConstructPoint(XCoordinate=series_2, YCoordinate=0, ZCoordinate=multiplication_2)
intcrv_2 = Interpolate(Vertices=pt_2, Degree=3, Periodic=False, KnotStyle=1)  # -> Curve, Length, Domain
mirror_2 = Mirror(Geometry=intcrv_2.Curve, Plane=PlaneYZ(0, 0, 0))  # -> Geometry, Transform
join_2 = JoinCurves(Curves=[intcrv_2.Curve, mirror_2.Geometry], Preserve=False)

pi = Pi(Factor=Slider(0.741, range=0..1))
dom = ConstructDomain(DomainStart=expr("x*10", Slider(65, range=0..100)), DomainEnd=expr("x*10", Slider(72, range=0..100)))
number_slider_4 = Slider(18, range=0..20)
range_3 = Range(Domain=pi, Steps=number_slider_2)
range_4 = Range(Domain=dom, Steps=number_slider_2)
pi_2 = Pi(Factor=Slider(0.741, range=0..1))
dom_2 = ConstructDomain(DomainStart=expr("x*10", Slider(65, range=0..100)), DomainEnd=expr("x*10", Slider(72, range=0..100)))
pt_3 = PointPolar(BasePlane=PlaneXY(0, 0, 0), XYAngle=range_3, ZAngle=0, Offset=Slider(359, range=0..1000))
pt_4 = PointPolar(BasePlane=PlaneXY(0, 0, 0), XYAngle=range_3, ZAngle=0, Offset=range_4)
range_5 = Range(Domain=pi_2, Steps=number_slider_4)
range_6 = Range(Domain=dom_2, Steps=number_slider_4)
range_7 = Range(Domain=Slider(551, range=0..1000), Steps=number_slider_2)
crv = Curve(<curve referenced from the Rhino model>)
Z = UnitZ(Factor=range_7)
pt_5 = PointPolar(BasePlane=PlaneXY(0, 0, 0), XYAngle=range_5, ZAngle=0, Offset=Slider(359, range=0..1000))
pt_6 = PointPolar(BasePlane=PlaneXY(0, 0, 0), XYAngle=range_5, ZAngle=0, Offset=range_6)
X = UnitX(Factor=1)
end = EndPoints(Curve=join)  # -> Start, End
area = Area(Geometry=crv)  # -> Area, Centroid
crv_2 = Curve(<curve referenced from the Rhino model>)
curvepoint = PointOnCurve(join, parameter=0.5)
eval = EvaluateCurve(Curve=join, Parameter=end.End)  # -> Point, Tangent, Angle
range_8 = Range(Domain=Slider(551, range=0..1000), Steps=number_slider_4)
move = Move(Geometry=pt_3, Motion=Z)  # -> Geometry, Transform
move_2 = Move(Geometry=pt_4, Motion=Z)  # -> Geometry, Transform
line = LineSDL(Start=area.Centroid, Direction=X, Length=Slider(10, range=0..10))
extrcrv = ExtrudeAlong()
X_2 = UnitX(Factor=1)
X_3 = UnitX(Factor=1)
area_2 = Area(Geometry=crv_2)  # -> Area, Centroid
Z_2 = UnitZ(Factor=range_8)
move_3 = Move(Geometry=pt_5, Motion=Z_2)  # -> Geometry, Transform
move_4 = Move(Geometry=pt_6, Motion=Z_2)  # -> Geometry, Transform
line_2 = LineSDL(Start=area_2.Centroid, Direction=X_3, Length=Slider(10, range=0..10))
line_3 = LineSDL(Start=curvepoint, Direction=X_2, Length=Slider(260, range=0..1000))
end_2 = EndPoints(Curve=join_2)  # -> Start, End
unit = UnitVector(Vector=line_2)
ln = Line(StartPoint=move_4.Geometry, EndPoint=move_3.Geometry)
unit_2 = UnitVector(Vector=end_2.End)
unit_3 = UnitVector(Vector=line)
ln_2 = Line(StartPoint=move_2.Geometry, EndPoint=move.Geometry)
unit_4 = UnitVector(Vector=line_3)
midpt = CurveMiddle(Curve=ln)
orient = OrientDirection(Geometry=crv, PointA=area.Centroid, DirectionA=unit_3, PointB=end.End, DirectionB=eval.Tangent)  # -> Geometry, Transform
orient_2 = OrientDirection(Geometry=crv_2, PointA=area_2.Centroid, DirectionA=unit, PointB=end_2.End, DirectionB=unit_2)  # -> Geometry, Transform
ln_3 = Line(StartPoint=move_4.Geometry, EndPoint=midpt)
curvepoint_2 = PointOnCurve(ln, parameter=0.5)
curvepoint_3 = PointOnCurve(ln_2, parameter=0.5)
unit_5 = UnitVector()
swp1 = Sweep1(Rail=join_2, Sections=orient_2.Geometry, Miter=1)
unit_6 = UnitVector(Vector=ln_3)
scale = Scale(Geometry=orient.Geometry, Center=end.End, Factor=Slider(0.3, range=0..10))  # -> Geometry, Transform
intcrv_3 = Interpolate(Vertices=move.Geometry, Degree=3, Periodic=False, KnotStyle=1)  # -> Curve, Length, Domain
curvepoint_4 = PointOnCurve(join, parameter=0.5)
swp1_2 = Sweep1(Rail=join, Sections=scale.Geometry, Miter=1)
orient_3 = OrientDirection(Geometry=join, PointA=curvepoint, DirectionA=flatten(unit_4), PointB=curvepoint_3, DirectionB=ln_2)  # -> Geometry, Transform
intcrv_4 = Interpolate(Vertices=curvepoint_2, Degree=3, Periodic=False, KnotStyle=1)  # -> Curve, Length, Domain
Y = UnitY(Factor=1)
end_3 = EndPoints(Curve=orient_3.Geometry)  # -> Start, End
line_4 = LineSDL(Start=curvepoint_4, Direction=Y, Length=Slider(10, range=0..10))
swp2 = Sweep2(SameHeight=False)
twist = Twist(Angle=1.570796327, Infinite=False, Rigid=False)
twist_2 = Twist(Geometry=intcrv_3.Curve, Axis=ln_2, Angle=expr("x*10", degrees(Slider(73, range=0..1000))), Infinite=False, Rigid=False)
end_4 = EndPoints()  # -> Start, End
X_4 = UnitX(Factor=1)
midpt_2 = CurveMiddle(Curve=join_2)
unit_7 = UnitVector(Vector=line_4)
move2pt = MoveToPoint(Geometry=swp1_2, PointA=curvepoint_4, PointB=curvepoint_3)  # -> Moved, Vector, Transform
vec2pt = Vector2Pt(Unitize=False)  # -> Vector, Length
pipe = Pipe(Curve=twist_2, Radius=1, Caps=0)
pframe = PerpFrame(Curve=reparameterize(orient_3.Geometry), Parameter=Slider(1, range=0..1))
vec = Vector()
twist_3 = Twist(Angle=1.570796327, Infinite=False, Rigid=False)
orient_4 = OrientDirection(Geometry=swp1, PointA=midpt_2, DirectionA=X_4, PointB=midpt, DirectionB=unit_6)  # -> Geometry, Transform
orient_5 = OrientDirection(PointA=Point(0, 0, 0), DirectionA=Vector(0, 0, 1), PointB=end_3.Start, DirectionB=pframe)  # -> Geometry, Transform
flip = FlipCurve(Curve=orient_3.Geometry)  # -> Curve, Flag
eval_2 = EvaluateLength(Curve=orient_3.Geometry, Length=Slider(1, range=0..1), Normalized=True)  # -> Point, Tangent, Parameter
line_5 = LineSDL(Start=end_3.End, Direction=eval_2.Tangent, Length=Slider(-41.986, range=-100..100))
end_5 = EndPoints(Curve=line_5)  # -> Start, End
orient_6 = OrientDirection(PointA=Point(0, 0, 0), DirectionA=Vector(0, 0, 1), PointB=end_5.Start, DirectionB=line_5)  # -> Geometry, Transform
scale_2 = Scale(Geometry=orient_6.Geometry, Center=end_5.Start, Factor=Slider(0.5, range=0..1))  # -> Geometry, Transform
extrcrv_2 = ExtrudeAlong(Base=scale_2.Geometry, Curve=flip.Curve)
